# Grasshopper definition forest_autosave4.gh (Grasshopper 1.0.7)
# plug-ins: horsterCameraControl, RhinoCodePluginGH

tree_number = Slider(3.4, range=0.5..3.5)

division = Division(A=tree_number, B="2")
division_2 = Division(A=division, B="2")
division_3 = Division(A=tree_number, B=Slider(20, range=0..100))
multiplication = Multiplication(A=tree_number, B="2")
multiplication_2 = Multiplication(A=multiplication, B="2")
power = Power(A=Slider(2.5, range=0..10), B=multiplication)
multiplication_3 = Multiplication(A=multiplication, B=multiplication)
multiplication_4 = Multiplication(A=tree_number, B="2")

construct_domain = ConstructDomain(DomainStart=Slider(0.5, range=0.5..3.5), DomainEnd=Slider(3.5, range=0.5..3.5))
multiplication_5 = Multiplication(A=Slider(40, range=0..10000), B=multiplication)

larger_than = LargerThan(FirstNumber=tree_number, SecondNumber=Slider(3, range=0..10))  # -> LargerThan, OrEqualTo
stream_gate = StreamGate(Stream=tree_number, Gate=larger_than.LargerThan)  # -> Target0, Target1
subtraction = Subtraction(A=stream_gate.Target1, B=Slider(3, range=0..10))
multiplication_6 = Multiplication(A=subtraction, B=Slider(1700, range=0..10000))
number_slider = Slider(1e-06, range=0..1)
subtraction_2 = Subtraction(A=Slider(610, range=0..1000), B=multiplication_6)
power_2 = Power(A=Slider(6.25, range=0..1000), B=stream_gate.Target0)
addition = Addition(A=number_slider, B=subtraction_2)
addition_2 = Addition(A=power_2, B=number_slider)
maximum = Maximum(A=addition_2, B=addition)

number_slider_2 = Slider(500, range=0..500)
construct_domain_2 = ConstructDomain(DomainStart=Slider(0, range=0..100), DomainEnd=number_slider_2)
curve = Curve(<curve referenced from the Rhino model>)
remap_numbers = RemapNumbers(Value=tree_number, Source=construct_domain, Target=construct_domain_2)  # -> Mapped, Clipped
evaluate_curve = EvaluateCurve(Curve=reparameterize(curve), Parameter=Slider(0, range=0..1))  # -> Point, Tangent, Angle
divide_curve = DivideCurve(Curve=curve, Count=number_slider_2, Kinks=False)  # -> Points, Tangents, Parameters

box = CenterBox(Base=PlaneXY(0, 0, 0), X=multiplication_2, Y=multiplication_2, Z=multiplication)
pop3d = Populate3D(Region=box, Count=multiplication_4, Seed=1)
round = Round(Number=multiplication_4)  # -> Nearest, Floor, Ceiling
sph = Sphere(Base=pop3d, Radius=division_2)
random = Random(Range=round.Ceiling, Number=1, Seed=2)
number_slider_3 = Slider(35.714, range=0..100)
popgeo = PopulateGeometry(Geometry=sph, Count=100, Seed=random)  # -> simplify(Population)
multiplication_7 = Multiplication(A=tree_number, B=number_slider_3)
multiplication_8 = Multiplication(A=tree_number, B=number_slider_3)
facet = FacetDome(Points=popgeo, Radius=random)  # -> Pattern, flatten(Dome)
subtraction_3 = Subtraction(A=Slider(100, range=0..100), B=multiplication_7)
scale = Scale(Geometry=facet.Pattern, Center=popgeo, Factor=multiplication_8)  # -> Geometry, Transform
unit_z = UnitZ(Factor=subtraction_3)
boundary = BoundarySurfaces(Edges=scale.Geometry)
move = Move(Geometry=boundary, Motion=unit_z)  # -> Geometry, Transform
mirror = Mirror(Geometry=move.Geometry, Plane=unit_z)  # -> Geometry, Transform
mirror_2 = Mirror(Geometry=mirror.Geometry, Plane=PlaneYZ(0, 0, 0))  # -> Geometry, Transform

box_corners = BoxCorners(Box=box)  # -> CornerA, CornerB, CornerC, CornerD, CornerE, CornerF, CornerG, CornerH
evaluate_length = EvaluateLength(Curve=curve, Length=division_3, Normalized=True)  # -> Point, Tangent, Parameter
panel = Panel(remap_numbers.Mapped)

subtraction_4 = Subtraction(A=round.Floor, B=Slider(0, range=0..1))
series = Series(Start=0, Step=1, Count=subtraction_4)
list_item = ListItem(List=pop3d, Index=series, Wrap=True)

list_item_2 = ListItem(List=pop3d, Index=subtraction_4, Wrap=True)
distance = Distance(PointA=box_corners.CornerE, PointB=list_item_2)
distance_2 = Distance(PointA=box_corners.CornerF, PointB=list_item_2)
distance_3 = Distance(PointA=box_corners.CornerH, PointB=list_item_2)
distance_4 = Distance(PointA=box_corners.CornerG, PointB=list_item_2)
script = Script(A=distance, B=distance_2, C=distance_4, D=distance_3)  # -> t, A1, B1, C1, D1
# ---------- script: Python ----------
A1=False
B1=False
C1=False
D1=False  

if A<B and A<C and A<D:
    A1=True
elif B<A and B<C and B<D:
    B1=True
elif C<A and C<B and C<D:
    C1=True
elif D<A and D<B and D<C:
    D1=True
# ---------- end script ----------
point = Point(Point(-26, -510, 0))
construct_point = ConstructPoint(XCoordinate=0, YCoordinate=0, ZCoordinate=0)
list_item_3 = ListItem(List=divide_curve.Points, Index=remap_numbers.Mapped, Wrap=True)
set_camera = SetCamera(CameraLocation=list_item_3, TargetLocation=construct_point, LensLength=Slider(20, range=0..100), Activate=Toggle(True))

python = GhPythonScript(p=multiplication_4, q=Slider(1, range=0..10), R=maximum, r=multiplication_3, npt=Slider(200, range=0..333))  # -> out, crv
# ---------- python: Python ----------
import rhinoscriptsyntax as rs
import math

def torus_knot(p, q, R, r, n_points=100):
    """
    Generate a torus knot curve.
    p, q: integers, parameters of the torus knot
    R: float, major radius of the torus
    r: float, minor radius of the torus
    n_points: number of points to generate
    """
    points = []
    for i in range(n_points):
        t = i / n_points * 2 * math.pi
        x = (R + r * math.cos(q * t)) * math.cos(p * t)
        y = (R + r * math.cos(q * t)) * math.sin(p * t)
        z = r * math.sin(q * t)
        points.append((x, y, z))
    return points

# Example: generate a torus knot curve with parameters (3, 4), major radius 5, minor radius 2, and 100 points
points = torus_knot(int(p), int(q), int(R), int(r), int(npt))
crv=rs.AddInterpCurve(points)
# ---------- end python ----------
cpoly = ControlPolygon(Curve=python.crv)  # -> Polygon, Points
nurbs = NurbsCurve(Vertices=cpoly.Points, Degree=3, Periodic=True)  # -> Curve, Length, Domain
pipe = Pipe(Curve=nurbs.Curve, Radius=Slider(1, range=0..1), Caps=0)

number_slider_4 = Slider(0, range=0..10)
python_2 = GhPythonScript(p=multiplication_4, q=Slider(1, range=0..10), R=multiplication_5, r=multiplication_3, npt=Slider(200, range=0..333))  # -> out, crv; same code as python
cpoly_2 = ControlPolygon(Curve=python_2.crv)  # -> Polygon, Points
nurbs_2 = NurbsCurve(Vertices=cpoly_2.Points, Degree=3, Periodic=True)  # -> Curve, Length, Domain
pipe_2 = Pipe(Curve=nurbs_2.Curve, Radius=Slider(0.4, range=0..1), Caps=0)

unit_z_2 = UnitZ(Factor=multiplication_4)
plane_surface = PlaneSurface(Plane=list_item, XSize=Domain(-10, 10), YSize=Domain(-10, 10))
extrude = Extrude(Base=plane_surface, Direction=unit_z_2)
deconstruct_brep = DeconstructBrep(Brep=extrude)  # -> Faces, Edges, Vertices
number_slider_5 = Slider(10, range=0..10)
number_slider_6 = Slider(5, range=0..10)
multiplication_9 = Multiplication(A=tree_number, B=number_slider_5)
division_4 = Division(A=tree_number, B=Slider(5, range=0..10))
popgeo_2 = PopulateGeometry(Geometry=deconstruct_brep.Faces, Count=100, Seed=number_slider_6)  # -> simplify(Population)
facet_2 = FacetDome(Points=popgeo_2, Radius=division_4)  # -> Pattern, flatten(Dome)
subtraction_5 = Subtraction(A=Slider(0, range=0..100), B=Slider(10, range=0..20))
scale_2 = Scale(Geometry=facet_2.Pattern, Center=popgeo_2, Factor=multiplication_9)  # -> Geometry, Transform
boundary_2 = BoundarySurfaces(Edges=scale_2.Geometry)
unit_z_3 = UnitZ(Factor=subtraction_5)
colour_swatch = ColourSwatch(SwatchColor=RGB(103, 0, 0))
move_2 = Move(Geometry=boundary_2, Motion=unit_z_3)  # -> Geometry, Transform

divide_curve_2 = DivideCurve(Curve=nurbs_2.Curve, Count=Slider(50, range=0..100), Kinks=False)  # -> Points, Tangents, Parameters
cone = Cone(Base=divide_curve_2.Points, Radius=multiplication, Length=multiplication_2)  # -> Cone, Tip
center_box = CenterBox(Base=divide_curve_2.Points, X=multiplication, Y=multiplication, Z=multiplication)

move_3 = Move(Geometry=pipe_2, Motion=Vector(0, 0, 10))  # -> Geometry, Transform
unit_x = UnitX(Factor=1)
extrude_2 = Extrude(Base=nurbs_2.Curve, Direction=unit_x)
unit_z_4 = UnitZ(Factor=multiplication)
deconstruct_brep_2 = DeconstructBrep(Brep=extrude_2)  # -> Faces, Edges, Vertices
addition_3 = Addition(A=tree_number, B=Slider(0.5, range=0..1))
extrude_3 = Extrude(Base=deconstruct_brep_2.Faces, Direction=unit_z_4)
pi = Pi(Factor=tree_number)
pi_2 = Pi(Factor=addition_3)
rotate = Rotate(Geometry=extrude_3, Angle=pi_2, Plane=PlaneXY(0, 0, 0))  # -> Geometry, Transform
rotate_2 = Rotate(Geometry=extrude_3, Angle=pi, Plane=PlaneXY(0, 0, 0))  # -> Geometry, Transform

xz_plane = XZPlane(Origin=Point(0, 0, 0))

unit_x_2 = UnitX(Factor=1)
move_4 = Move(Geometry=pipe, Motion=Vector(0, 0, 10))  # -> Geometry, Transform
extrude_4 = Extrude(Base=nurbs.Curve, Direction=unit_x_2)
unit_z_5 = UnitZ(Factor=multiplication)
deconstruct_brep_3 = DeconstructBrep(Brep=extrude_4)  # -> Faces, Edges, Vertices
addition_4 = Addition(A=tree_number, B=tree_number)
extrude_5 = Extrude(Base=deconstruct_brep_3.Faces, Direction=unit_z_5)
pi_3 = Pi(Factor=tree_number)
pi_4 = Pi(Factor=addition_4)
rotate_3 = Rotate(Geometry=extrude_5, Angle=pi_4, Plane=xz_plane)  # -> Geometry, Transform
rotate_4 = Rotate(Geometry=extrude_5, Angle=pi_3, Plane=PlaneXY(0, 0, 0))  # -> Geometry, Transform

deconstruct_brep_4 = DeconstructBrep(Brep=rotate_2.Geometry)  # -> Faces, Edges, Vertices
deconstruct_brep_5 = DeconstructBrep(Brep=rotate_4.Geometry)  # -> Faces, Edges, Vertices
deconstruct_brep_6 = DeconstructBrep(Brep=rotate_3.Geometry)  # -> Faces, Edges, Vertices
division_5 = Division(A=number_slider_5, B=Slider(10, range=0..10))
multiplication_10 = Multiplication(A=division_5, B=Slider(2.8, range=0..10))
multiplication_11 = Multiplication(A=multiplication_10, B=Slider(1.3, range=0..10))

subtraction_6 = Subtraction(A=tree_number, B=division_5)
larger_than_2 = LargerThan(FirstNumber=tree_number, SecondNumber=division_5)  # -> LargerThan, OrEqualTo
multiplication_12 = Multiplication(A=Slider(0.33, range=0..1), B=subtraction_6)
pi_5 = Pi(Factor=multiplication_12)
xz_plane_2 = XZPlane(Origin=Point(0, 0, 0))
stream_gate_2 = StreamGate(Stream=rotate_2.Geometry, Gate=larger_than_2.LargerThan)  # -> Target0, Target1
rotate_5 = Rotate(Geometry=stream_gate_2.Target1, Angle=pi_5, Plane=xz_plane_2)  # -> Geometry, Transform
rotate_6 = Rotate(Geometry=stream_gate_2.Target1, Angle=Slider(0, range=0..100), Plane=xz_plane_2)  # -> Geometry, Transform

deconstruct_brep_7 = DeconstructBrep(Brep=rotate_5.Geometry)  # -> Faces, Edges, Vertices
xy_plane = XYPlane(Origin=Point(0, 0, 0))
pi_6 = Pi(Factor=multiplication)
number_slider_7 = Slider(3.4, range=0..10)
gradient = Gradient(
    LowerLimit=0,
    UpperLimit=Slider(80, range=0..1000),
    Parameter=multiplication_7,
    stops=[0: RGB(255, 181, 130), 0.408: RGB(41, 227, 62), 0.926: RGB(220, 116, 0)])
smaller_than = SmallerThan(FirstNumber=tree_number, SecondNumber=number_slider_7)  # -> SmallerThan, OrEqualTo
larger_than_3 = LargerThan(FirstNumber=tree_number, SecondNumber=number_slider_7)  # -> LargerThan, OrEqualTo
unit_z_6 = UnitZ(Factor=Slider(30, range=0..100))
stream_gate_3 = StreamGate(Stream=move_2.Geometry, Gate=larger_than_3.OrEqualTo)  # -> Target0, Target1
rotate_7 = Rotate(Geometry=center_box, Angle=pi_5, Plane=xz_plane_2)  # -> Geometry, Transform
colour_swatch_2 = ColourSwatch(SwatchColor=RGB(150, 41, 41))
colour_swatch_3 = ColourSwatch(SwatchColor=RGB(33, 0, 0))
colour_swatch_4 = ColourSwatch(SwatchColor=RGB(255, 135, 135))
custom_preview = CustomPreview(Geometry=boundary, Material=gradient)
custom_preview_2 = CustomPreview(Geometry=mirror_2.Geometry, Material=gradient)
custom_preview_3 = CustomPreview(Geometry=mirror.Geometry, Material=gradient)
custom_preview_4 = CustomPreview(Geometry=move.Geometry, Material=gradient)
custom_preview_5 = CustomPreview(Geometry=rotate_6.Geometry, Material=colour_swatch_3)
custom_preview_6 = CustomPreview(Geometry=stream_gate_3.Target1, Material=colour_swatch_2)
custom_preview_7 = CustomPreview(Geometry=cone.Cone, Material=colour_swatch_4)
custom_preview_8 = CustomPreview(Geometry=rotate_5.Geometry, Material=colour_swatch_3)
custom_preview_9 = CustomPreview(Geometry=rotate_7.Geometry, Material=colour_swatch_4)

number_slider_8 = Slider(1.4, range=0..10)
larger_than_4 = LargerThan(FirstNumber=tree_number, SecondNumber=number_slider_8)  # -> LargerThan, OrEqualTo
stream_gate_4 = StreamGate(Stream=tree_number, Gate=larger_than_4.LargerThan)  # -> Target0, Target1
power_3 = Power(A=stream_gate_4.Target1, B=Slider(2, range=0..100))
power_4 = Power(A=stream_gate_4.Target1, B=Slider(2, range=0..10))
cir = Circle(Plane=PlaneXY(0, 0, 0), Radius=power_3)
cir_2 = Circle(Plane=PlaneXY(0, 0, 0), Radius=power_4)
pframes = PerpFrames(Curve=cir, Count=10, Align=True)  # -> Frames, Parameters
orient = Orient(Geometry=cir_2, Source=PlaneXY(0, 0, 0), Target=pframes.Frames)  # -> Geometry, Transform
loft = Loft(Curves=orient.Geometry, Options={Adjust=False, Closed=True, LoftEnds=0, LoftSimp=0, LoftType=0, Rebuild=10, Refit=0.01})
sdivide = DivideSurface(Surface=loft, UCount=multiplication_2, VCount=multiplication_2)  # -> Points, Normals, Parameters
pi_7 = Pi(Factor=tree_number)
number_slider_9 = Slider(4, range=0..10)
gradient_2 = Gradient(
    LowerLimit=Slider(1, range=0..10),
    UpperLimit=number_slider_9,
    Parameter=tree_number,
    stops=[0.145: RGB(255, 181, 130), 0.345: RGB(41, 227, 62), 0.961: RGB(220, 116, 0)])
power_5 = Power(A=power_4, B=Slider(2, range=0..10))
vector_xyz = VectorXYZ(XComponent=power_5, YComponent=power_3, ZComponent=power_5)  # -> Vector, Length
yz_plane = YZPlane(Origin=Point(0, 0, 0))
xy_plane_2 = XYPlane(Origin=Point(0, 0, 0))

power_6 = Power(A=tree_number, B=Slider(7, range=0..100))
larger_than_5 = LargerThan(FirstNumber=tree_number, SecondNumber=Slider(3.1, range=0..10))  # -> LargerThan, OrEqualTo
toggle = BooleanToggle(True)
attractor = Point(Point(0.1381230481, 0.06189081432, 0))
point_attraction = Cluster(
    PointAttractor=attractor,
    AttractionField=power_6,
    AttractorForce=power_6,
    VisualizeVectors=toggle,
    PointArray=sdivide.Points,
    PointAttractor_2=attractor,
    AttractionField_2=power_6,
    AttractorForce_2=power_6,
    VisualizeVectors_2=toggle,
    PointArray_2=sdivide.Points,
    PointA=point_attraction.Attractor,
    PointB=point_attraction.PointArray,
    List=point_attraction.Distance,
    Keys=point_attraction.Distance,
    List_2=point_attraction.List,
    Index=expr("x-1", point_attraction.Length),
    Wrap=False,
    GraphMapper=point_attraction.Result,
    A=point_attraction.Distance,
    B=point_attraction.Element,
    FirstNumber=point_attraction.Distance,
    SecondNumber=point_attraction.AttractionField,
    List_3=point_attraction.PointArray,
    DispatchPattern=point_attraction.OrEqualTo,
    Pattern=point_attraction.OrEqualTo,
    Stream0=point_attraction.Series,
    Stream1=point_attraction.GraphMapper,
    PointA_2=point_attraction.ListA,
    PointB_2=point_attraction.Attractor,
    Point=point_attraction.ListB,
    List_4=point_attraction.Point,
    Start=0,
    Step=0,
    Count=point_attraction.Length,
    Center=point_attraction.Attractor,
    Normal=Vector(0, 0, 1),
    Radius=point_attraction.AttractionField,
    PointA_3=point_attraction.PointArray,
    PointB_3=point_attraction.Attractor,
    Unitize=False,
    Anchor=point_attraction.PointArray,
    Vector=point_attraction.List,
    Vector_2=point_attraction.Vector,
    Vector_3=point_attraction.Vector,
    Amplitude=point_attraction.Result,
    A_2=point_attraction.Weave,
    B_2=point_attraction.AttractorForce,
    Geometry=point_attraction.PointArray,
    Translation=point_attraction.Vector,
    Geometry_2=point_attraction.Circle,
    Shader=point_attraction.ColourSwatch,
    Vector_4=point_attraction.Vector,
    Geometry_3=point_attraction.Geometry,
    Circle=point_attraction.Circle,
    Data=point_attraction.Vector,
    Path="{0}",
    Data_2=point_attraction.Geometry,
    Path_2="{0}",
    A_3=point_attraction.OrEqualTo,
    B_3=point_attraction.VisualizeVectors,
    FirstNumber_2=point_attraction.Vector,
    SecondNumber_2=0,
    List_5=point_attraction.Vector,
    CullPattern=point_attraction.Result,
    InternalDocument_plugin_version=(1, 0, 7),
    InternalDocument_DocumentHeader_PreviewMeshType=1,
    InternalDocument_DocumentHeader_PreviewNormal=RGBA(150, 0, 0, 150),
    InternalDocument_DocumentHeader_PreviewSelected=RGBA(0, 150, 0, 150),
    InternalDocument_DefinitionProperties_Projection_Zoom=0.08589936793,
    InternalDocument_DefinitionObjects_Object11_Container_NullGaps=False,
    stops=[0: RGB(128, 0, 128), 0.516: RGB(255, 165, 0), 1: RGB(0, 250, 154)])  # -> NewVectors, NewPoints, Circle, NewVectors_2, NewPoints_2, Circle_2
stream_gate_5 = StreamGate(Stream=point_attraction.NewVectors_2, Gate=larger_than_5.LargerThan)  # -> Target0, Target1

pt = Point(point_attraction.NewPoints_2)
srf_cp = SurfaceCP(Point=pt, Surface=loft)  # -> Point, UVPoint, Distance
intcrv = Interpolate(Vertices=srf_cp.Point, Degree=3, Periodic=False)  # -> Curve, Length, Domain
pipe_3 = Pipe(Curve=intcrv.Curve, Radius="0.2", Caps=0)
flip = FlipMatrix(Data=srf_cp.Point)
intcrv_2 = Interpolate(Vertices=flip, Degree=3, Periodic=False)  # -> Curve, Length, Domain
rotate_8 = Rotate(Geometry=pipe_3, Angle=pi_7, Plane=PlaneXY(0, 0, 0))  # -> Geometry, Transform
pipe_4 = Pipe(Curve=intcrv_2.Curve, Radius="0.2", Caps=0)
deconstruct_brep_8 = DeconstructBrep(Brep=pipe_3)  # -> Faces, Edges, Vertices
populate_geometry = PopulateGeometry(Geometry=deconstruct_brep_8.Faces, Count=100, Seed=1)
facet_3 = FacetDome(Points=populate_geometry, Radius=multiplication)  # -> Pattern, flatten(Dome)
scale_3 = Scale(Geometry=facet_3.Pattern, Center=populate_geometry, Factor=tree_number)  # -> Geometry, Transform
boundary_3 = BoundarySurfaces(Edges=scale_3.Geometry)
move_5 = Move(Geometry=boundary_3, Motion=vector_xyz.Vector)  # -> Geometry, Transform
mirror_3 = Mirror(Geometry=move_5.Geometry, Plane=xy_plane_2)  # -> Geometry, Transform
mirror_4 = Mirror(Geometry=mirror_3.Geometry, Plane=yz_plane)  # -> Geometry, Transform
mirror_5 = Mirror(Geometry=move_5.Geometry, Plane=yz_plane)  # -> Geometry, Transform

popgeo_3 = PopulateGeometry(Geometry=python_2.crv, Count=100, Seed=number_slider_6)  # -> simplify(Population)
facet_4 = FacetDome(Points=popgeo_3, Radius=number_slider_6)  # -> Pattern, flatten(Dome)
subtraction_7 = Subtraction(A=tree_number, B=number_slider_8)
multiplication_13 = Multiplication(A=Slider(3, range=0..100), B=subtraction_7)
scale_4 = Scale(Geometry=facet_4.Pattern, Center=popgeo_3, Factor=multiplication_13)  # -> Geometry, Transform
boundary_4 = BoundarySurfaces(Edges=scale_4.Geometry)
stream_gate_6 = StreamGate(Stream=boundary_4, Gate=larger_than_4.LargerThan)  # -> Target0, Target1

rotate_9 = Rotate(Geometry=stream_gate_6.Target1, Angle=pi_6, Plane=xy_plane)  # -> Geometry, Transform
gradient_3 = Gradient(
    LowerLimit=0,
    UpperLimit=number_slider_9,
    Parameter=multiplication_13,
    stops=[0: RGB(255, 181, 130), 0.408: RGB(41, 227, 62), 0.926: RGB(220, 116, 0)])
custom_preview_10 = CustomPreview(Geometry=rotate_9.Geometry, Material=gradient_3)
custom_preview_11 = CustomPreview(Geometry=move_5.Geometry, Material=gradient_2)
custom_preview_12 = CustomPreview(Geometry=mirror_5.Geometry, Material=gradient_2)
custom_preview_13 = CustomPreview(Geometry=mirror_3.Geometry, Material=gradient_2)
custom_preview_14 = CustomPreview(Geometry=mirror_4.Geometry, Material=gradient_2)

number_slider_10 = Slider(2.8, range=0..10)
larger_than_6 = LargerThan(FirstNumber=multiplication_10, SecondNumber=tree_number)  # -> LargerThan, OrEqualTo
stream_gate_7 = StreamGate(Stream=move_2.Geometry, Gate=larger_than_6.LargerThan)  # -> Target0, Target1

popgeo_4 = PopulateGeometry(Geometry=deconstruct_brep_5.Faces, Count=100, Seed=number_slider_6)  # -> simplify(Population)
facet_5 = FacetDome(Points=popgeo_4, Radius=number_slider_6)  # -> Pattern, flatten(Dome)
subtraction_8 = Subtraction(A=tree_number)
multiplication_14 = Multiplication(A=Slider(0.5, range=0..100), B=subtraction_8)
scale_5 = Scale(Geometry=facet_5.Pattern, Center=popgeo_4, Factor=multiplication_14)  # -> Geometry, Transform
boundary_5 = BoundarySurfaces(Edges=scale_5.Geometry)
stream_gate_8 = StreamGate(Stream=boundary_5, Gate=larger_than_6.LargerThan)  # -> Target0, Target1
colour_swatch_5 = ColourSwatch(SwatchColor=RGB(107, 0, 0))

popgeo_5 = PopulateGeometry(Geometry=deconstruct_brep_6.Faces, Count=100, Seed=number_slider_6)  # -> simplify(Population)
facet_6 = FacetDome(Points=popgeo_5, Radius=number_slider_6)  # -> Pattern, flatten(Dome)
number_slider_11 = Slider(0.5, range=0..100)
subtraction_9 = Subtraction(A=tree_number)
multiplication_15 = Multiplication(A=number_slider_11, B=subtraction_9)
scale_6 = Scale(Geometry=facet_6.Pattern, Center=popgeo_5, Factor=multiplication_15)  # -> Geometry, Transform
boundary_6 = BoundarySurfaces(Edges=scale_6.Geometry)
stream_gate_9 = StreamGate(Stream=boundary_6, Gate=larger_than_6.LargerThan)  # -> Target0, Target1

popgeo_6 = PopulateGeometry(Geometry=deconstruct_brep_7.Faces, Count=100, Seed=number_slider_6)  # -> simplify(Population)
facet_7 = FacetDome(Points=popgeo_6, Radius=number_slider_6)  # -> Pattern, flatten(Dome)
subtraction_10 = Subtraction(A=tree_number)
multiplication_16 = Multiplication(A=number_slider_11, B=subtraction_10)
scale_7 = Scale(Geometry=facet_7.Pattern, Center=popgeo_6, Factor=multiplication_16)  # -> Geometry, Transform
boundary_7 = BoundarySurfaces(Edges=scale_7.Geometry)
stream_gate_10 = StreamGate(Stream=boundary_7, Gate=larger_than_6.LargerThan)  # -> Target0, Target1

popgeo_7 = PopulateGeometry(Geometry=deconstruct_brep_4.Faces, Count=100, Seed=number_slider_6)  # -> simplify(Population)
facet_8 = FacetDome(Points=popgeo_7, Radius=number_slider_6)  # -> Pattern, flatten(Dome)
subtraction_11 = Subtraction(A=tree_number)
multiplication_17 = Multiplication(A=number_slider_11, B=subtraction_11)
scale_8 = Scale(Geometry=facet_8.Pattern, Center=popgeo_7, Factor=multiplication_17)  # -> Geometry, Transform
boundary_8 = BoundarySurfaces(Edges=scale_8.Geometry)
stream_gate_11 = StreamGate(Stream=boundary_8, Gate=larger_than_6.LargerThan)  # -> Target0, Target1

gate_not = GateNot(A=larger_than_6.LargerThan)
gate_and = GateAnd(A=gate_not, B=smaller_than.SmallerThan)
stream_gate_12 = StreamGate(Stream=move_2.Geometry, Gate=gate_and)  # -> Target0, Target1

explode = Explode(Curve=stream_gate_12.Target1, Recursive=True)  # -> Segments, Vertices

extrude_6 = Extrude(Base=explode.Segments, Direction=unit_z_6)
custom_preview_15 = CustomPreview(Geometry=explode.Vertices, Material=colour_swatch_2)
custom_preview_16 = CustomPreview(Geometry=extrude_6, Material=colour_swatch_2)
custom_preview_17 = CustomPreview(Geometry=stream_gate_7.Target1, Material=colour_swatch_2)
custom_preview_18 = CustomPreview(Geometry=stream_gate_10.Target0, Material=ColourSwatch(SwatchColor=RGB(107, 0, 0)))
custom_preview_19 = CustomPreview(Geometry=stream_gate_8.Target0, Material=colour_swatch_5)
custom_preview_20 = CustomPreview(Geometry=stream_gate_11.Target0, Material=ColourSwatch(SwatchColor=RGB(107, 0, 0)))
custom_preview_21 = CustomPreview(Geometry=stream_gate_9.Target0, Material=ColourSwatch(SwatchColor=RGB(107, 0, 0)))
custom_preview_22 = CustomPreview(Geometry=rotate_3.Geometry, Material=colour_swatch_5)
custom_preview_23 = CustomPreview(Geometry=rotate_4.Geometry, Material=colour_swatch_5)
